# Dynamo graph AlignmentCreationTests.dyn (Dynamo 2.13.1.3887)
# packages: Camber 4.1.3

string = StringInput("0")
current = Autodesk.AutoCAD.DynamoNodes.Document.Current()
modelSpace = Autodesk.AutoCAD.DynamoNodes.Document.ModelSpace(document=current)
all_objects_on_layer = AcObjectsOnLayer(layer=string, block=modelSpace)
code_block = CodeBlock { 1; }
count = List.Count(list=all_objects_on_layer)
sequence = Sequence(start=code_block, amount=count)
code_block_2 = CodeBlock(count=sequence) { "Alignment-" + count; }
string_2 = StringInput("C-ROAD")
alignment_styles = AlignmentStyleDropDown("Proposed")
alignment_label_set_styles = AlignmentLabelSetStyleNamesDropDown("Major Minor and Geometry Points")
number = DoubleInput(50)
byPolyline = Camber.Civil.CivilObjects.Alignment.ByPolyline(polyline=all_objects_on_layer, name=code_block_2, layer=string_2, style=alignment_styles, labelSet=alignment_label_set_styles, startStation=number)  # unwired: document
code_block_3 = CodeBlock { true; }
select_object = ObjectSelection()  # 1 picked in the model
geometry = Camber.Civil.CivilObjects.Alignment.Geometry(alignment=select_object)
code_block_4 = CodeBlock { 0; }
setStartStation = Camber.Civil.CivilObjects.Alignment.SetStartStation(alignment=select_object, startStation=code_block_4)
