# Dynamo graph AlignmentTests.dyn (Dynamo 2.13.1.3887)
# packages: Camber 4.0.0

current = Autodesk.AutoCAD.DynamoNodes.Document.Current()
alignments = Alignments(document=current)
alignment_label_set_styles = AlignmentLabelSetStyleNamesDropDown("All Labels")
importLabelSet = Camber.Civil.CivilObjects.Alignment.ImportLabelSet(alignment=alignments, labelSetStyleName=alignment_label_set_styles)
