# Dynamo graph CodeSetStyleTests.dyn (Dynamo 2.13.1.3887)
# packages: Camber 4.0.0

code_set_styles = CodeSetStyleDropDown("Basic")
code_block = CodeBlock { "TestPoint"; }
marker_styles = MarkerStyleDropDown("Basic")
addPointItem = Camber.Civil.Styles.CodeSets.CodeSetStyle.AddPointItem(codeSetStyle=code_set_styles, code=code_block, markerStyle=marker_styles)
code_block_2 = CodeBlock { "TestLink"; }
link_styles = LinkStyleDropDown("Barrier")
addLinkItem = Camber.Civil.Styles.CodeSets.CodeSetStyle.AddLinkItem(codeSetStyle=code_set_styles, code=code_block_2, linkStyle=link_styles)
code_block_3 = CodeBlock { "TestShape"; }
shape_styles = ShapeStyleDropDown("Barrier")
addShapeItem = Camber.Civil.Styles.CodeSets.CodeSetStyle.AddShapeItem(codeSetStyle=code_set_styles, code=code_block_3, shapeStyle=shape_styles)
code_block_4 = CodeBlock(a=addPointItem, b=addLinkItem, c=addShapeItem) { [a,b,c][0]; }
codeSetStyleItems = Camber.Civil.Styles.CodeSets.CodeSetStyle.CodeSetStyleItems(codeSetStyle=code_block_4)
classification = Camber.Civil.Styles.CodeSets.CodeSetStyleItem.Classification(codeSetStyleItem=codeSetStyleItems)
code = Camber.Civil.Styles.CodeSets.CodeSetStyleItem.Code(codeSetStyleItem=codeSetStyleItems)
codeSetStyle = Camber.Civil.Styles.CodeSets.CodeSetStyleItem.CodeSetStyle(codeSetStyleItem=codeSetStyleItems)
codeStyle = Camber.Civil.Styles.CodeSets.CodeSetStyleItem.CodeStyle(codeSetStyleItem=codeSetStyleItems)
description = Camber.Civil.Styles.CodeSets.CodeSetStyleItem.Description(codeSetStyleItem=codeSetStyleItems)
featureLineStyle = Camber.Civil.Styles.CodeSets.CodeSetStyleItem.FeatureLineStyle(codeSetStyleItem=codeSetStyleItems)
itemType = Camber.Civil.Styles.CodeSets.CodeSetStyleItem.ItemType(codeSetStyleItem=codeSetStyleItems)
labelStyle = Camber.Civil.Styles.CodeSets.CodeSetStyleItem.LabelStyle(codeSetStyleItem=codeSetStyleItems)
materialAreaFillStyle = Camber.Civil.Styles.CodeSets.CodeSetStyleItem.MaterialAreaFillStyle(codeSetStyleItem=codeSetStyleItems)
payItems = Camber.Civil.Styles.CodeSets.CodeSetStyleItem.PayItems(codeSetStyleItem=codeSetStyleItems)
renderMaterialStyle = Camber.Civil.Styles.CodeSets.CodeSetStyleItem.RenderMaterialStyle(codeSetStyleItem=codeSetStyleItems)
subentityStyleType = Camber.Civil.Styles.CodeSets.CodeSetStyleItem.SubentityStyleType(codeSetStyleItem=codeSetStyleItems)
code_block_5 = CodeBlock { "TestDescription"; }
setDescription = Camber.Civil.Styles.CodeSets.CodeSetStyleItem.SetDescription(codeSetStyleItem=codeSetStyleItems, description=code_block_5)
