# Dynamo graph DisplayStyleTests.dyn (Dynamo 2.13.1.3887)
# packages: Camber 4.0.0

pipe_styles = PipeStyleDropDown("Single Line (Sanitary)")
display_style_view_directions = DisplayStyleViewDirectionsDropDown("Model", EnumerationType="Camber.Civil.Styles.DisplayStyleViewDirections, Camber, Version=4.0.0.0, Culture=neutral, PublicKeyToken=null", AddSpaces=false, DropLastCharacter=false)
getDisplayStyles = Camber.Civil.Styles.Style.GetDisplayStyles(style=pipe_styles, viewDirection=display_style_view_directions)
code_block = CodeBlock(a=getDisplayStyles) { a[0]; }
string = StringInput("0")
setLayer = Camber.Civil.Styles.DisplayStyle.SetLayer(displayStyle=code_block, layer=string)
