# Dynamo graph DrawingSettingsTests.dyn (Dynamo 2.13.1.3887)
# packages: Camber 4.0.1

current = Autodesk.AutoCAD.DynamoNodes.Document.Current()
unitsZoneSettings = Camber.AutoCAD.Document.UnitsZoneSettings(document=current)
angular_unit_types = AngularUnitTypesDropDown("Degree", EnumerationType="Autodesk.Civil.AngleUnitType, AeccDbMgd, Version=13.5.131.0, Culture=neutral, PublicKeyToken=null", AddSpaces=false, DropLastCharacter=false)
setAngularUnits = Camber.AutoCAD.Document.SetAngularUnits(document=current, angularUnitType=angular_unit_types)
boolean = BoolSelector(false)
setAutoCADVariablesToMatch = Camber.AutoCAD.Document.SetAutoCADVariablesToMatch(document=current, matchVariables=boolean)
coordinate_system_codes = CoordinateSystemCodesDropDown("CA83IIIF")
setCoordinateSystemCode = Camber.AutoCAD.Document.SetCoordinateSystemCode(document=current, code=coordinate_system_codes)
number_slider = DoubleSlider(30, range=10..100 step 10)
setDrawingScale = Camber.AutoCAD.Document.SetDrawingScale(document=current, scale=number_slider)
boolean_2 = BoolSelector(true)
setDrawingUnits = Camber.AutoCAD.Document.SetDrawingUnits(document=current, useFeet=boolean_2)
setImperialToMetricConversion = Camber.AutoCAD.Document.SetImperialToMetricConversion(document=current, useInternationalFoot=boolean)
setScaleObjectsFromOtherDrawings = Camber.AutoCAD.Document.SetScaleObjectsFromOtherDrawings(document=current, scaleObjects=boolean)
