# Dynamo graph ExternalBlockReferenceTests.dyn (Dynamo 2.13.1.3887)
# packages: Camber 4.0.0

file_path = Filename(".\ExternalBlockReferenceTests.dwg")
boolean = BoolSelector(false)
loadFromFile = Camber.External.ExternalDocument.LoadFromFile(filePath=file_path, lock=boolean)
string = StringInput("Test")
blockByName = Camber.External.ExternalDocument.BlockByName(externalDocument=loadFromFile, name=string)
blockReferences = Camber.External.ExternalBlock.BlockReferences(externalBlock=blockByName)
attributeTags = Camber.External.ExternalObjects.ExternalBlockReference.AttributeTags(externalBlockReference=blockReferences)
string_2 = StringInput("DynamicTest")
blockByName_2 = Camber.External.ExternalDocument.BlockByName(externalDocument=loadFromFile, name=string_2)
blockReferences_2 = Camber.External.ExternalBlock.BlockReferences(externalBlock=blockByName_2)
code_block = CodeBlock { "Distance1"; }
dynamicPropertyByName = Camber.External.ExternalObjects.ExternalBlockReference.DynamicPropertyByName(externalBlockReference=blockReferences_2, name=code_block)
hasAttributes = Camber.External.ExternalObjects.ExternalBlockReference.HasAttributes(externalBlockReference=blockReferences)
isDynamic = Camber.External.ExternalObjects.ExternalBlockReference.IsDynamic(externalBlockReference=blockReferences_2)
string_3 = StringInput("Station")
string_4 = StringInput("2+00")
setAttributeByTag = Camber.External.ExternalObjects.ExternalBlockReference.SetAttributeByTag(externalBlockReference=blockReferences, tag=string_3, value=string_4)
string_5 = StringInput("Offset")
string_6 = StringInput("15.32")
setAttributeByTag_2 = Camber.External.ExternalObjects.ExternalBlockReference.SetAttributeByTag(externalBlockReference=setAttributeByTag, tag=string_5, value=string_6)
string_7 = StringInput("Constant")
string_8 = StringInput("Shouldn't work")
setAttributeByTag_3 = Camber.External.ExternalObjects.ExternalBlockReference.SetAttributeByTag(externalBlockReference=setAttributeByTag_2, tag=string_7, value=string_8)
dynamicPropertyNames = Camber.External.ExternalObjects.ExternalBlockReference.DynamicPropertyNames(externalBlockReference=blockReferences_2)
