# Dynamo graph ExternalDBPointTests.dyn (Dynamo 2.13.1.3887)
# packages: Camber 4.0.0

file_path = Filename(".\ExternalDBPointTests.dwg")
boolean = BoolSelector(false)
loadFromFile = Camber.External.ExternalDocument.LoadFromFile(filePath=file_path, lock=boolean)
modelSpace = Camber.External.ExternalDocument.ModelSpace(externalDocument=loadFromFile)
objects = Camber.External.ExternalBlock.Objects(externalBlock=modelSpace)
thickness = Camber.External.ExternalObjects.ExternalDBPoint.Thickness(externalDBPoint=objects)
code_block = CodeBlock { "NewLayer"; }
geometry = Camber.External.ExternalObjects.ExternalObject.Geometry(externalObject=objects)
code_block_2 = CodeBlock { 5; }
translate = Geometry.Translate(geometry=geometry, xTranslation=code_block_2)
byPoint = Camber.External.ExternalObjects.ExternalDBPoint.ByPoint(block=modelSpace, layer=code_block, point=translate)
code_block_3 = CodeBlock(pass=loadFromFile, wait=byPoint) { [pass,wait][0]; }
save = Camber.External.ExternalDocument.Save(externalDocument=code_block_3)
