# Dynamo graph ExternalDocumentSettingsTests.dyn (Dynamo 2.13.1.3887)
# packages: Camber 4.0.1

file_path = Filename("C:\Software Projects\Camber\tests\Document\DocumentSettingsTests.dwg")
loadFromFile = Camber.External.ExternalDocument.LoadFromFile(filePath=file_path)
getUnitsZoneSettings = Camber.External.ExternalDocument.GetUnitsZoneSettings(externalDocument=loadFromFile)
code_block = CodeBlock { "CA83-IIF"; }
setCoordinateSystemCode = Camber.External.ExternalDocument.SetCoordinateSystemCode(externalDocument=loadFromFile, code=code_block)
coordinateSystemCodes = Camber.External.ExternalDocument.CoordinateSystemCodes(externalDocument=loadFromFile)
angular_unit_types = AngularUnitTypesDropDown("Grad", EnumerationType="Autodesk.Civil.AngleUnitType, AeccDbMgd, Version=13.5.131.0, Culture=neutral, PublicKeyToken=null", AddSpaces=false, DropLastCharacter=false)
setAngularUnits = Camber.External.ExternalDocument.SetAngularUnits(externalDocument=loadFromFile, angularUnitType=angular_unit_types)
