# Dynamo graph ExternalLayoutTests.dyn (Dynamo 2.13.1.3887)
# packages: Camber 4.0.1

block = Camber.External.ExternalLayout.Block()  # unwired: externalLayout
tabOrder = Camber.External.ExternalLayout.TabOrder()  # unwired: externalLayout
file_path = Filename("C:\Software Projects\Camber\tests\ExternalLayout\ExternalLayoutTests.dwg")
loadFromFile = Camber.External.ExternalDocument.LoadFromFile(filePath=file_path)
code_block = CodeBlock { "Layout1"; }
byName = Camber.External.ExternalLayout.ByName(externalDocument=loadFromFile, name=code_block)  # unwired: pageSetupName
layoutByName = Camber.External.ExternalDocument.LayoutByName(externalDocument=loadFromFile, name=code_block)
boolean = BoolSelector(true)
layouts = Camber.External.ExternalDocument.Layouts(externalDocument=loadFromFile, includeModel=boolean)
code_block_2 = CodeBlock(a=layouts) { a[1]; }
setName = Camber.External.ExternalLayout.SetName(externalLayout=code_block_2)  # unwired: newName
code_block_3 = CodeBlock { "Layout3"; }
code_block_4 = CodeBlock { "Layout4"; }
namedPageSetups = Camber.External.ExternalDocument.NamedPageSetups(externalDocument=loadFromFile)
code_block_5 = CodeBlock(a=namedPageSetups) { a[0]; }
byName_2 = Camber.External.ExternalLayout.ByName(externalDocument=loadFromFile, name=code_block_4, pageSetupName=code_block_5)
