# Dynamo graph ByPoint.dyn (Dynamo 2.15.1.6076)
# packages: Camber 4.2.1

file_path = Filename(".\ExternalMTextTests.dwg")
loadFromFile = Camber.External.ExternalDocument.LoadFromFile(filePath=file_path)
origin = Point.Origin()
code_block = CodeBlock()
# ---------- code_block.designscript (2 lines) ----------
["Single line test",
"First line\nSecond line"];
# ----------------------------------------
string = StringInput("NewTestLayer")
modelSpace = Camber.External.ExternalDocument.ModelSpace(externalDocument=loadFromFile)
number = DoubleInput(1)
number_2 = DoubleInput(0)
byPoint = Camber.External.ExternalObjects.ExternalMText.ByPoint(point=origin, contents=code_block, layer=string, block=modelSpace, textHeight=number, rotation=number_2)
code_block_2 = CodeBlock(pass=loadFromFile, wait=byPoint) { [pass, wait][0]; }
save = Camber.External.ExternalDocument.Save(externalDocument=code_block_2)
