# Dynamo graph GetProperties.dyn (Dynamo 2.15.1.6076)
# packages: Camber 4.2.1

file_path = Filename(".\ExternalMTextTests.dwg")
loadFromFile = Camber.External.ExternalDocument.LoadFromFile(filePath=file_path)
modelSpace = Camber.External.ExternalDocument.ModelSpace(externalDocument=loadFromFile)
objects = Camber.External.ExternalBlock.Objects(externalBlock=modelSpace)
attachment = Camber.External.ExternalObjects.ExternalMText.Attachment(externalMText=objects)
columns = Camber.External.ExternalObjects.ExternalMText.Columns(externalMText=objects)
height = Camber.External.ExternalObjects.ExternalMText.Height(externalMText=objects)
insertionPoint = Camber.External.ExternalObjects.ExternalMText.InsertionPoint(externalMText=objects)
textHeight = Camber.External.ExternalObjects.ExternalMText.TextHeight(externalMText=objects)
textStyle = Camber.External.ExternalObjects.ExternalMText.TextStyle(externalMText=objects)
width = Camber.External.ExternalObjects.ExternalMText.Width(externalMText=objects)
