# Dynamo graph SetProperties.dyn (Dynamo 2.15.1.6076)
# packages: Camber 4.2.1

file_path = Filename(".\ExternalMTextTests.dwg")
loadFromFile = Camber.External.ExternalDocument.LoadFromFile(filePath=file_path)
origin = Point.Origin()
string = StringInput("Test")
string_2 = StringInput("NewTestLayer")
modelSpace = Camber.External.ExternalDocument.ModelSpace(externalDocument=loadFromFile)
number = DoubleInput(1)
number_2 = DoubleInput(0)
byPoint = Camber.External.ExternalObjects.ExternalMText.ByPoint(point=origin, contents=string, layer=string_2, block=modelSpace, textHeight=number, rotation=number_2)
MTextVerticalAttachment = VerticalAttachment("Middle")
MTextHorizontalAttachment = HorizontalAttachment("Left")
setAttachment = Camber.External.ExternalObjects.ExternalMText.SetAttachment(externalMText=byPoint, verticalAttachment=MTextVerticalAttachment, horizontalAttachment=MTextHorizontalAttachment)
string_3 = StringInput("New Contents")
setContents = Camber.External.ExternalObjects.ExternalMText.SetContents(externalMText=setAttachment, contents=string_3)
code_block = CodeBlock { 10; }
setHeight = Camber.External.ExternalObjects.ExternalMText.SetHeight(externalMText=setContents, height=code_block)
setWidth = Camber.External.ExternalObjects.ExternalMText.SetWidth(externalMText=setHeight, width=code_block)
code_block_2 = CodeBlock { 2; }
setTextHeight = Camber.External.ExternalObjects.ExternalMText.SetTextHeight(externalMText=setWidth, textHeight=code_block_2)
code_block_3 = CodeBlock { "Standard"; }
setTextStyle = Camber.External.ExternalObjects.ExternalMText.SetTextStyle(externalMText=setTextHeight, textStyleName=code_block_3)
code_block_4 = CodeBlock(pass=loadFromFile, wait=setTextStyle) { [pass, wait][0]; }
save = Camber.External.ExternalDocument.Save(externalDocument=code_block_4)
attachment = Camber.External.ExternalObjects.ExternalMText.Attachment(externalMText=setAttachment)
