# Dynamo graph FieldTests.dyn (Dynamo 2.13.1.3887)
# packages: Camber 4.0.1

objects_types = AcObjectTypes("MText")
current = Autodesk.AutoCAD.DynamoNodes.Document.Current()
modelSpace = Autodesk.AutoCAD.DynamoNodes.Document.ModelSpace(document=current)
all_objects_of_type = AcObjectsOfType(type=objects_types, block=modelSpace)
fields = Camber.AutoCAD.Objects.Object.Fields(object=all_objects_of_type)
code_block = CodeBlock { false; }
clean = List.Clean(list=fields, preserveIndices=code_block)
value = Camber.AutoCAD.Field.Value(field=clean)
state = Camber.AutoCAD.Field.State(field=clean)
dataType = Camber.AutoCAD.Field.DataType(field=clean)
evaluationOption = Camber.AutoCAD.Field.EvaluationOption(field=clean)
code_block_2 = CodeBlock(a=clean) { a[1][0]; }
format = Camber.AutoCAD.Field.Format(field=code_block_2)
valueFormatted = Camber.AutoCAD.Field.ValueFormatted(field=clean)
referencedObjects = Camber.AutoCAD.Field.ReferencedObjects(field=code_block_2)
setExpression = Camber.AutoCAD.Field.SetExpression(field=code_block_2)  # unwired: fieldExpression
boolean = BoolSelector(true)
getEmbeddedFields = Camber.AutoCAD.Field.GetEmbeddedFields(field=code_block_2, recursive=boolean)
expression = Camber.AutoCAD.Field.Expression(field=getEmbeddedFields)
