# Dynamo graph GridSurfaceTests.dyn (Dynamo 2.13.1.3887)
# packages: Camber 4.0.0

current = Autodesk.AutoCAD.DynamoNodes.Document.Current()
code_block = CodeBlock { "Test"; }
number_slider = DoubleSlider(5, range=0..10 step 1)
code_block_2 = CodeBlock { 0; }
surface_styles = SurfaceStyleDropDown("Contours 1' and 5' (Background)")
byName = Camber.Civil.CivilObjects.Surfaces.GridSurface.ByName(document=current, surfaceName=code_block, spacingX=number_slider, spacingY=number_slider, orientation=code_block_2, style=surface_styles)
file_path = Filename(".\491_926.asc")
importFromDEM = Camber.Civil.CivilObjects.Surfaces.GridSurface.ImportFromDEM(document=current, demFilePath=file_path, style=surface_styles)
getVertices = Camber.Civil.CivilObjects.Surfaces.GridSurface.GetVertices(gridSurface=importFromDEM)
mesh = Camber.Civil.CivilObjects.Surfaces.GridSurface.Mesh(gridSurface=importFromDEM)
getCells = Camber.Civil.CivilObjects.Surfaces.GridSurface.GetCells(gridSurface=importFromDEM)
