# Dynamo graph LandXML_Export.dyn (Dynamo 2.13.1.3887)
# packages: Camber 2.0.0

string = StringInput(".\")
string_2 = StringInput("LandXMLTest")
export = Camber.LandXML.LandXML.Export(folderPath=string, fileName=string_2)
