# Dynamo graph LandXML_Import.dyn (Dynamo 2.13.1.3887)
# packages: Camber 2.0.0

file_path = Filename(".\LandXMLTest.xml")
loadFromFile = Camber.LandXML.LandXML.LoadFromFile(filePath=file_path)
current = Autodesk.AutoCAD.DynamoNodes.Document.Current()
import_ = Camber.LandXML.LandXML.Import(landXML=loadFromFile, document=current)
