# Dynamo graph LandXML_ReadData.dyn (Dynamo 2.13.1.3887)
# packages: Camber 2.0.0

file_path = Filename(".\LandXMLTest.xml")
loadFromFile = Camber.LandXML.LandXML.LoadFromFile(filePath=file_path)
application = Camber.LandXML.LandXML.Application(landXML=loadFromFile)
author = Camber.LandXML.LandXML.Author(landXML=loadFromFile)
coordinateSystem = Camber.LandXML.LandXML.CoordinateSystem(landXML=loadFromFile)
dateCreated = Camber.LandXML.LandXML.DateCreated(landXML=loadFromFile)
directory = Camber.LandXML.LandXML.Directory(landXML=loadFromFile)
language = Camber.LandXML.LandXML.Language(landXML=loadFromFile)
name = Camber.LandXML.LandXML.Name(landXML=loadFromFile)
project = Camber.LandXML.LandXML.Project(landXML=loadFromFile)
path = Camber.LandXML.LandXML.Path(landXML=loadFromFile)
schemaVersion = Camber.LandXML.LandXML.SchemaVersion(landXML=loadFromFile)
units = Camber.LandXML.LandXML.Units(landXML=loadFromFile)
