# Dynamo graph MTextTests.dyn (Dynamo 2.13.1.3887)
# packages: Camber 4.0.0

objects_types = AcObjectTypes("MText")
current = Autodesk.AutoCAD.DynamoNodes.Document.Current()
modelSpace = Autodesk.AutoCAD.DynamoNodes.Document.ModelSpace(document=current)
all_objects_of_type = AcObjectsOfType(type=objects_types, block=modelSpace)
string = StringInput("DynamicDimensions")
setTextStyle = Camber.AutoCAD.Objects.MText.SetTextStyle(mText=all_objects_of_type, textStyleName=string)
textStyle = Camber.AutoCAD.Objects.MText.TextStyle(mText=setTextStyle)
