# Dynamo graph MVBlocksTest.dyn (Dynamo 2.15.1.6076)
# packages: Camber 4.1.4

current = Autodesk.AutoCAD.DynamoNodes.Document.Current()
multiViewBlocks = Camber.AutoCAD.Document.MultiViewBlocks(document=current)
multiViewBlockReferences = Camber.AutoCAD.Objects.MultiViewBlocks.MultiViewBlock.MultiViewBlockReferences(multiViewBlock=multiViewBlocks)
