# Dynamo graph AlignmentMigrationTests.dyn (Dynamo 2.19.4.6671)
# packages: Camber 4.2.6

objects_types = AcObjectTypes("Alignment")
current = Autodesk.AutoCAD.DynamoNodes.Document.Current()
modelSpace = Autodesk.AutoCAD.DynamoNodes.Document.ModelSpace(document=current)
all_objects_of_type = AcObjectsOfType(type=objects_types, block=modelSpace)
geometry = Camber.Civil.CivilObjects.Alignment.Geometry(alignment=all_objects_of_type)
watch = Watch(geometry)
string = StringInput("All Labels")
importLabelSet = Camber.Civil.CivilObjects.Alignment.ImportLabelSet(alignment=all_objects_of_type, labelSetStyleName=string)
watch_2 = Watch(importLabelSet)
profileViews = Camber.Civil.CivilObjects.Alignment.ProfileViews(alignment=all_objects_of_type)
watch_3 = Watch(profileViews)
sampleLineGroups = Camber.Civil.CivilObjects.Alignment.SampleLineGroups(alignment=all_objects_of_type)
watch_4 = Watch(sampleLineGroups)
number = DoubleInput(0)
setStartStation = Camber.Civil.CivilObjects.Alignment.SetStartStation(alignment=all_objects_of_type, startStation=number)
watch_5 = Watch(setStartStation)
