# Dynamo graph BlockMigrationTests.dyn (Dynamo 2.19.4.6671)
# packages: Camber 4.2.6

block_units = BlockUnitsDropDown("Feet", EnumerationType="Autodesk.AutoCAD.DatabaseServices.UnitsValue, Acdbmgd, Version=24.3.0.0, Culture=neutral, PublicKeyToken=null", AddSpaces=false, DropLastCharacter=false)
watch = Watch(block_units)
current = Autodesk.AutoCAD.DynamoNodes.Document.Current()
string = StringInput("Well")
blockByName = Autodesk.AutoCAD.DynamoNodes.Document.BlockByName(document=current, name=string)
setUnits = Camber.AutoCAD.Objects.Block.SetUnits(block=blockByName, units=block_units)
watch_2 = Watch(setUnits)
setDescription = Camber.AutoCAD.Objects.Block.SetDescription(block=blockByName, description=string)
watch_3 = Watch(setDescription)
isAnonymous = Camber.AutoCAD.Objects.Block.IsAnonymous(block=blockByName)
watch_4 = Watch(isAnonymous)
isDynamic = Camber.AutoCAD.Objects.Block.IsDynamic(block=blockByName)
watch_5 = Watch(isDynamic)
setName = Camber.AutoCAD.Objects.Block.SetName(block=blockByName, name=string)
watch_6 = Watch(setName)
units = Camber.AutoCAD.Objects.Block.Units(block=blockByName)
watch_7 = Watch(units)
explodable = Camber.AutoCAD.Objects.Block.Explodable(block=blockByName)
watch_8 = Watch(explodable)
boolean = BoolSelector(true)
setExplodable = Camber.AutoCAD.Objects.Block.SetExplodable(block=blockByName, bool=boolean)
watch_9 = Watch(setExplodable)
