# Dynamo graph CivilObjectMigrationTests.dyn (Dynamo 2.19.4.6671)
# packages: Camber 4.2.6

string = StringInput("Test")
byName = Camber.Civil.PipeNetworks.PipeNetwork.ByName(name=string)
getReferenceInfo = Camber.Civil.CivilObjects.CivilObject.GetReferenceInfo(civilObject=byName)
isReference = Camber.Civil.CivilObjects.CivilObject.IsReference(civilObject=byName)
watch = Watch(isReference)
