# Dynamo graph DocumentMigrationTests.dyn (Dynamo 2.19.4.6671)
# packages: Camber 4.2.6

current = Autodesk.AutoCAD.DynamoNodes.Document.Current()
string = StringInput("FILEDIA")
integer_slider = IntegerSlider(1, range=0..1 step 1)
setSystemVariable = Camber.AutoCAD.Document.SetSystemVariable(document=current, variableName=string, newValue=integer_slider)
watch = Watch(setSystemVariable)
string_2 = StringInput("ID83-WF")
setCoordinateSystemCode = Camber.AutoCAD.Document.SetCoordinateSystemCode(document=current, code=string_2)
watch_2 = Watch(setCoordinateSystemCode)
getSystemVariable = Camber.AutoCAD.Document.GetSystemVariable(document=current, variableName=string)
watch_3 = Watch(getSystemVariable)
code_block = CodeBlock { 40; }
setDrawingScale = Camber.AutoCAD.Document.SetDrawingScale(document=current, scale=code_block)
watch_4 = Watch(setDrawingScale)
isReadOnly = Camber.AutoCAD.Document.IsReadOnly(document=current)
watch_5 = Watch(isReadOnly)
isNamedDrawing = Camber.AutoCAD.Document.IsNamedDrawing(document=current)
watch_6 = Watch(isNamedDrawing)
