# Dynamo graph LayerMigrationTests.dyn (Dynamo 2.19.4.6671)
# packages: Camber 4.2.6

current = Autodesk.AutoCAD.DynamoNodes.Document.Current()
layers = Autodesk.AutoCAD.DynamoNodes.Document.Layers(document=current)
layerByName = Autodesk.AutoCAD.DynamoNodes.Document.LayerByName(document=current, name=layers)
getColorInfo = Camber.AutoCAD.Objects.Layer.GetColorInfo(layer=layerByName)
integer_slider = IntegerSlider(1, range=0..255 step 1)
setColor = Camber.AutoCAD.Objects.Layer.SetColor(layer=layerByName, colorIndex=integer_slider)
watch = Watch(setColor)
lineweight = Camber.AutoCAD.Objects.Layer.Lineweight(layer=layerByName)
watch_2 = Watch(lineweight)
lineweight_list = Lineweight("Default")
setLineweight = Camber.AutoCAD.Objects.Layer.SetLineweight(layer=layerByName, lineweight=lineweight_list)
watch_3 = Watch(setLineweight)
