# Dynamo graph LayoutMigrationTests.dyn (Dynamo 2.19.4.6671)
# packages: Camber 4.2.6

current = Autodesk.AutoCAD.DynamoNodes.Document.Current()
getLayouts = Camber.AutoCAD.Layout.GetLayouts(document=current)
block = Camber.AutoCAD.Layout.Block(layout=getLayouts)
watch = Watch(block)
watch_2 = Watch(getLayouts)
watch_3 = Watch(getLayouts)
string = StringInput("Layout1")
getLayoutByName = Camber.AutoCAD.Layout.GetLayoutByName(document=current, name=string)
watch_4 = Watch(getLayoutByName)
name = Camber.AutoCAD.Layout.Name(layout=getLayouts)
watch_5 = Watch(name)
tabOrder = Camber.AutoCAD.Layout.TabOrder(layout=getLayouts)
watch_6 = Watch(tabOrder)
reorder = Camber.AutoCAD.Layout.Reorder(layouts=getLayouts)
watch_7 = Watch(reorder)
setName = Camber.AutoCAD.Layout.SetName(layout=getLayouts, newName=name)
watch_8 = Watch(setName)
named_page_setups = NamedPageSetupsDropDown()  # nothing selected
watch_9 = Watch(named_page_setups)
