# Dynamo graph MTextMigrationTests.dyn (Dynamo 2.19.4.6671)
# packages: Camber 4.2.6

string = StringInput("Test")
origin = Point.Origin()
current = Autodesk.AutoCAD.DynamoNodes.Document.Current()
currentLayer = Autodesk.AutoCAD.DynamoNodes.Document.CurrentLayer(document=current)
modelSpace = Autodesk.AutoCAD.DynamoNodes.Document.ModelSpace(document=current)
create = Autodesk.AutoCAD.DynamoNodes.MText.Create(text=string, insertionPoint=origin, layer=currentLayer, block=modelSpace)
text_styles = TextStylesDropDown("Standard")
setTextStyle = Camber.AutoCAD.Objects.MText.SetTextStyle(mText=create, textStyleName=text_styles)
watch = Watch(setTextStyle)
textStyle = Camber.AutoCAD.Objects.MText.TextStyle(mText=create)
watch_2 = Watch(textStyle)
