# Dynamo graph MultileaderMigrationTests.dyn (Dynamo 2.19.4.6671)
# packages: Camber 4.2.6

origin = Point.Origin()
current = Autodesk.AutoCAD.DynamoNodes.Document.Current()
string = StringInput("Well")
blockByName = Autodesk.AutoCAD.DynamoNodes.Document.BlockByName(document=current, name=string)
code_block = CodeBlock { 10; }
byCoordinates = Vector.ByCoordinates(x=code_block, y=code_block)
byPointBlock = Camber.AutoCAD.Objects.MLeader.ByPointBlock(point=origin, block=blockByName, draggedOffset=byCoordinates)
watch = Watch(byPointBlock)
block = Camber.AutoCAD.Objects.MLeader.Block(mLeader=byPointBlock)
watch_2 = Watch(block)
string_2 = StringInput("Test")
byPointText = Camber.AutoCAD.Objects.MLeader.ByPointText(point=origin, text=string_2, draggedOffset=byCoordinates)
watch_3 = Watch(byPointText)
blockPosition = Camber.AutoCAD.Objects.MLeader.BlockPosition(mLeader=byPointBlock)
watch_4 = Watch(blockPosition)
contentType = Camber.AutoCAD.Objects.MLeader.ContentType(mLeader=byPointText)
watch_5 = Watch(contentType)
string_3 = StringInput("TAG")
getAttributeValueByTag = Camber.AutoCAD.Objects.MLeader.GetAttributeValueByTag(mLeader=byPointBlock, tagName=string_3)
watch_6 = Watch(getAttributeValueByTag)
setAttributeValueByTag = Camber.AutoCAD.Objects.MLeader.SetAttributeValueByTag(mLeader=byPointBlock, tagName=string_3, value=string_3)
watch_7 = Watch(setAttributeValueByTag)
leaderPoints = Camber.AutoCAD.Objects.MLeader.LeaderPoints(mLeader=byPointText)
watch_8 = Watch(leaderPoints)
scale = Camber.AutoCAD.Objects.MLeader.Scale(mLeader=byPointText)
watch_9 = Watch(scale)
textLocation = Camber.AutoCAD.Objects.MLeader.TextLocation(mLeader=byPointText)
watch_10 = Watch(textLocation)
leaderLineCount = Camber.AutoCAD.Objects.MLeader.LeaderLineCount(mLeader=byPointText)
watch_11 = Watch(leaderLineCount)
