# Dynamo graph ObjectMigrationTests.dyn (Dynamo 2.19.4.6671)
# packages: Camber 4.2.6

origin = Point.Origin()
code_block = CodeBlock { 5; }
byCoordinates = Point.ByCoordinates(x=code_block)
byStartPointEndPoint = Line.ByStartPointEndPoint(startPoint=origin, endPoint=byCoordinates)
current = Autodesk.AutoCAD.DynamoNodes.Document.Current()
currentLayer = Autodesk.AutoCAD.DynamoNodes.Document.CurrentLayer(document=current)
modelSpace = Autodesk.AutoCAD.DynamoNodes.Document.ModelSpace(document=current)
byGeometry = Autodesk.AutoCAD.DynamoNodes.Object.ByGeometry(geometry=byStartPointEndPoint, layer=currentLayer, block=modelSpace)
code_block_2 = CodeBlock { 1; }
setColor = Camber.AutoCAD.Objects.Object.SetColor(object=byGeometry, colorIndex=code_block_2)
watch = Watch(setColor)
colorIndex = Camber.AutoCAD.Objects.Object.ColorIndex(object=byGeometry)
watch_2 = Watch(colorIndex)
