# Dynamo graph PartMigrationTests.dyn (Dynamo 2.19.4.6671)
# packages: Camber 4.2.6

string = StringInput("Test2")
byName = Camber.Civil.PipeNetworks.PipeNetwork.ByName(name=string)
pipes = Camber.Civil.PipeNetworks.PipeNetwork.Pipes(pipeNetwork=byName)
objects_types = AcObjectTypes("Alignment")
current = Autodesk.AutoCAD.DynamoNodes.Document.Current()
modelSpace = Autodesk.AutoCAD.DynamoNodes.Document.ModelSpace(document=current)
all_objects_of_type = AcObjectsOfType(type=objects_types, block=modelSpace)
addToProfileView = Camber.Civil.PipeNetworks.Parts.Part.AddToProfileView(part=pipes, profileView=all_objects_of_type)
applyRules = Camber.Civil.PipeNetworks.Parts.Part.ApplyRules(part=pipes)
removeFromProfileView = Camber.Civil.PipeNetworks.Parts.Part.RemoveFromProfileView(part=pipes, profileView=all_objects_of_type)
referenceAlignment = Camber.Civil.PipeNetworks.Parts.Part.ReferenceAlignment(part=pipes)
setReferenceAlignment = Camber.Civil.PipeNetworks.Parts.Part.SetReferenceAlignment(part=pipes, alignment=referenceAlignment)
referenceSurface = Camber.Civil.PipeNetworks.Parts.Part.ReferenceSurface(part=pipes)
setReferenceSurface = Camber.Civil.PipeNetworks.Parts.Part.SetReferenceSurface(part=pipes, surface=referenceSurface)
swap = Camber.Civil.PipeNetworks.Parts.Part.Swap()  # unwired: part, newPartFamily, newPartSize
domain = Camber.Civil.PipeNetworks.Parts.Part.Domain(part=pipes)
material = Camber.Civil.PipeNetworks.Parts.Part.Material(part=pipes)
partDescription = Camber.Civil.PipeNetworks.Parts.Part.PartDescription(part=pipes)
partSubType = Camber.Civil.PipeNetworks.Parts.Part.PartSubType(part=pipes)
pipeNetwork = Camber.Civil.PipeNetworks.Parts.Part.PipeNetwork(part=pipes)
profileViewsDisplayedIn = Camber.Civil.PipeNetworks.Parts.Part.ProfileViewsDisplayedIn(part=pipes)
sectionsViewsDisplayedIn = Camber.Civil.PipeNetworks.Parts.Part.SectionsViewsDisplayedIn(part=pipes)
wallThickness = Camber.Civil.PipeNetworks.Parts.Part.WallThickness(part=pipes)
