# Dynamo graph PipeMigrationTests.dyn (Dynamo 2.19.4.6671)
# packages: Camber 4.2.6

string = StringInput("Test2")
byName = Camber.Civil.PipeNetworks.PipeNetwork.ByName(name=string)
pipes = Camber.Civil.PipeNetworks.PipeNetwork.Pipes(pipeNetwork=byName)
bearing = Camber.Civil.PipeNetworks.Parts.Pipe.Bearing(pipe=pipes)
coverEnd = Camber.Civil.PipeNetworks.Parts.Pipe.CoverEnd(pipe=pipes)
coverMax = Camber.Civil.PipeNetworks.Parts.Pipe.CoverMax(pipe=pipes)
coverMin = Camber.Civil.PipeNetworks.Parts.Pipe.CoverMin(pipe=pipes)
coverStart = Camber.Civil.PipeNetworks.Parts.Pipe.CoverStart(pipe=pipes)
crossSectionalShape = Camber.Civil.PipeNetworks.Parts.Pipe.CrossSectionalShape(pipe=pipes)
EGLDown = Camber.Civil.PipeNetworks.Parts.Pipe.EGLDown(pipe=pipes)
EGLUp = Camber.Civil.PipeNetworks.Parts.Pipe.EGLUp(pipe=pipes)
endOffset = Camber.Civil.PipeNetworks.Parts.Pipe.EndOffset(pipe=pipes)
endPoint = Camber.Civil.PipeNetworks.Parts.Pipe.EndPoint(pipe=pipes)
endStation = Camber.Civil.PipeNetworks.Parts.Pipe.EndStation(pipe=pipes)
endStructure = Camber.Civil.PipeNetworks.Parts.Pipe.EndStructure(pipe=pipes)
flowDirectionMethod = Camber.Civil.PipeNetworks.Parts.Pipe.FlowDirectionMethod(pipe=pipes)
flowRate = Camber.Civil.PipeNetworks.Parts.Pipe.FlowRate(pipe=pipes)
HGLDown = Camber.Civil.PipeNetworks.Parts.Pipe.HGLDown(pipe=pipes)
HGLUp = Camber.Civil.PipeNetworks.Parts.Pipe.HGLUp(pipe=pipes)
innerDiameterOrWidth = Camber.Civil.PipeNetworks.Parts.Pipe.InnerDiameterOrWidth(pipe=pipes)
innerHeight = Camber.Civil.PipeNetworks.Parts.Pipe.InnerHeight(pipe=pipes)
junctionLoss = Camber.Civil.PipeNetworks.Parts.Pipe.JunctionLoss(pipe=pipes)
length2DCenterToCenter = Camber.Civil.PipeNetworks.Parts.Pipe.Length2DCenterToCenter(pipe=pipes)
length2DToInsideEdge = Camber.Civil.PipeNetworks.Parts.Pipe.Length2DToInsideEdge(pipe=pipes)
length3DCenterToCenter = Camber.Civil.PipeNetworks.Parts.Pipe.Length3DCenterToCenter(pipe=pipes)
length3DToInsideEdge = Camber.Civil.PipeNetworks.Parts.Pipe.Length3DToInsideEdge(pipe=pipes)
outerDiameterOrWidth = Camber.Civil.PipeNetworks.Parts.Pipe.OuterDiameterOrWidth(pipe=pipes)
outerHeight = Camber.Civil.PipeNetworks.Parts.Pipe.OuterHeight(pipe=pipes)
radius = Camber.Civil.PipeNetworks.Parts.Pipe.Radius(pipe=pipes)
code_block = CodeBlock { 12; }
boolean = BoolSelector(true)
resizeByInnerDimension = Camber.Civil.PipeNetworks.Parts.Pipe.ResizeByInnerDimension(pipe=pipes, newSize=code_block, useClosestSize=boolean)
returnPeriod = Camber.Civil.PipeNetworks.Parts.Pipe.ReturnPeriod(pipe=pipes)
code_block_2 = CodeBlock { 0.02; }
setSlopeHoldEnd = Camber.Civil.PipeNetworks.Parts.Pipe.SetSlopeHoldEnd(pipe=pipes, slope=code_block_2)
setSlopeHoldStart = Camber.Civil.PipeNetworks.Parts.Pipe.SetSlopeHoldStart(pipe=setSlopeHoldEnd, slope=code_block_2)
slope = Camber.Civil.PipeNetworks.Parts.Pipe.Slope(pipe=setSlopeHoldEnd)
startOffset = Camber.Civil.PipeNetworks.Parts.Pipe.StartOffset(pipe=setSlopeHoldEnd)
startPoint = Camber.Civil.PipeNetworks.Parts.Pipe.StartPoint(pipe=setSlopeHoldEnd)
startStation = Camber.Civil.PipeNetworks.Parts.Pipe.StartStation(pipe=setSlopeHoldEnd)
startStructure = Camber.Civil.PipeNetworks.Parts.Pipe.StartStructure(pipe=setSlopeHoldEnd)
