# Dynamo graph PipeNetworkMigrationTests.dyn (Dynamo 2.19.4.6671)
# packages: Camber 4.2.6

string = StringInput("Test3")
byName = Camber.Civil.PipeNetworks.PipeNetwork.ByName(name=string)
pipes = Camber.Civil.PipeNetworks.PipeNetwork.Pipes(pipeNetwork=byName)
findShortestNetworkPath = Camber.Civil.PipeNetworks.PipeNetwork.FindShortestNetworkPath(startPart=pipes, endPart=pipes)
current = Autodesk.AutoCAD.DynamoNodes.Document.Current()
getPipeNetworkByName = Camber.Civil.PipeNetworks.PipeNetwork.GetPipeNetworkByName(document=current, name=string)
getPipeNetworks = Camber.Civil.PipeNetworks.PipeNetwork.GetPipeNetworks(document=current)
referenceAlignment = Camber.Civil.PipeNetworks.PipeNetwork.ReferenceAlignment(pipeNetwork=byName)
referenceSurface = Camber.Civil.PipeNetworks.PipeNetwork.ReferenceSurface(pipeNetwork=byName)
structures = Camber.Civil.PipeNetworks.PipeNetwork.Structures(pipeNetwork=byName)
