# Dynamo graph Polyline3DMigrationTests.dyn (Dynamo 2.19.4.6671)
# packages: Camber 4.2.6

origin = Point.Origin()
code_block = CodeBlock { 5; }
byCoordinates = Point.ByCoordinates(x=code_block)
list_create = List.Create(item0=origin, item1=byCoordinates)
current = Autodesk.AutoCAD.DynamoNodes.Document.Current()
currentLayer = Autodesk.AutoCAD.DynamoNodes.Document.CurrentLayer(document=current)
modelSpace = Autodesk.AutoCAD.DynamoNodes.Document.ModelSpace(document=current)
byPoints = Autodesk.AutoCAD.DynamoNodes.Polyline3D.ByPoints(points=list_create, layer=currentLayer, block=modelSpace)
isClosed = Camber.AutoCAD.Objects.Polyline3D.IsClosed(polyline3d=byPoints)
watch = Watch(isClosed)
setIsClosed = Camber.AutoCAD.Objects.Polyline3D.SetIsClosed(polyline3d=byPoints, value=isClosed)
watch_2 = Watch(setIsClosed)
