# Dynamo graph PolylineMigrationTests.dyn (Dynamo 2.19.4.6671)
# packages: Camber 4.2.6

origin = Point.Origin()
code_block = CodeBlock { 5; }
byCoordinates = Point.ByCoordinates(x=code_block)
list_create = List.Create(item0=origin, item1=byCoordinates)
current = Autodesk.AutoCAD.DynamoNodes.Document.Current()
currentLayer = Autodesk.AutoCAD.DynamoNodes.Document.CurrentLayer(document=current)
modelSpace = Autodesk.AutoCAD.DynamoNodes.Document.ModelSpace(document=current)
byPoints = Autodesk.AutoCAD.DynamoNodes.Polyline.ByPoints(points=list_create, layer=currentLayer, block=modelSpace)
elevation = Camber.AutoCAD.Objects.Polyline.Elevation(polyline=byPoints)
watch = Watch(elevation)
globalWidth = Camber.AutoCAD.Objects.Polyline.GlobalWidth(polyline=byPoints)
watch_2 = Watch(globalWidth)
isClosed = Camber.AutoCAD.Objects.Polyline.IsClosed(polyline=byPoints)
watch_3 = Watch(isClosed)
setElevation = Camber.AutoCAD.Objects.Polyline.SetElevation(polyline=byPoints, elevation=elevation)
watch_4 = Watch(setElevation)
setGlobalWidth = Camber.AutoCAD.Objects.Polyline.SetGlobalWidth(polyline=byPoints, width=globalWidth)
watch_5 = Watch(setGlobalWidth)
setIsClosed = Camber.AutoCAD.Objects.Polyline.SetIsClosed(polyline=byPoints, value=isClosed)
watch_6 = Watch(setIsClosed)
