# Dynamo graph PressureNetworkMigrationTests.dyn (Dynamo 2.19.4.6671)
# packages: Camber 4.2.6

current = Autodesk.AutoCAD.DynamoNodes.Document.Current()
getPressureNetworks = Camber.Civil.PressureNetworks.PressureNetwork.GetPressureNetworks(document=current)
string = StringInput("Test")
getPressureNetworkByName = Camber.Civil.PressureNetworks.PressureNetwork.GetPressureNetworkByName(document=current, name=string)
byName = Camber.Civil.PressureNetworks.PressureNetwork.ByName(name=string)
appurtenances = Camber.Civil.PressureNetworks.PressureNetwork.Appurtenances(pressureNetwork=byName)
fittings = Camber.Civil.PressureNetworks.PressureNetwork.Fittings(pressureNetwork=byName)
pressurePipes = Camber.Civil.PressureNetworks.PressureNetwork.PressurePipes(pressureNetwork=byName)
