# Dynamo graph PressurePartMigrationTests.dyn (Dynamo 2.19.4.6671)
# packages: Camber 4.2.6

string = StringInput("Test1")
byName = Camber.Civil.PressureNetworks.PressureNetwork.ByName(name=string)
pressurePipes = Camber.Civil.PressureNetworks.PressureNetwork.PressurePipes(pressureNetwork=byName)
referenceAlignment = Camber.Civil.PressureNetworks.Parts.PressurePart.ReferenceAlignment(pressurePart=pressurePipes)
profileViews = Camber.Civil.CivilObjects.Alignment.ProfileViews(alignment=referenceAlignment)
addToProfileView = Camber.Civil.PressureNetworks.Parts.PressurePart.AddToProfileView(pressurePart=pressurePipes, profileView=profileViews)
removeFromProfileView = Camber.Civil.PressureNetworks.Parts.PressurePart.RemoveFromProfileView(pressurePart=addToProfileView, profileView=profileViews)
origin = Point.Origin()
setPosition = Camber.Civil.PressureNetworks.Parts.PressurePart.SetPosition(pressurePart=pressurePipes, point=origin)
setReferenceAlignment = Camber.Civil.PressureNetworks.Parts.PressurePart.SetReferenceAlignment(pressurePart=pressurePipes, alignment=referenceAlignment)
referenceSurface = Camber.Civil.PressureNetworks.Parts.PressurePart.ReferenceSurface(pressurePart=pressurePipes)
setReferenceSurface = Camber.Civil.PressureNetworks.Parts.PressurePart.SetReferenceSurface(pressurePart=pressurePipes, surface=referenceSurface)
domain = Camber.Civil.PressureNetworks.Parts.PressurePart.Domain(pressurePart=pressurePipes)
partData = Camber.Civil.PressureNetworks.Parts.PressurePart.PartData(pressurePart=pressurePipes)
partDescription = Camber.Civil.PressureNetworks.Parts.PressurePart.PartDescription(pressurePart=pressurePipes)
partType = Camber.Civil.PressureNetworks.Parts.PressurePart.PartType(pressurePart=pressurePipes)
pressureNetwork = Camber.Civil.PressureNetworks.Parts.PressurePart.PressureNetwork(pressurePart=pressurePipes)
profileViewsDisplayedIn = Camber.Civil.PressureNetworks.Parts.PressurePart.ProfileViewsDisplayedIn(pressurePart=pressurePipes)
solid = Camber.Civil.PressureNetworks.Parts.PressurePart.Solid(pressurePart=pressurePipes)
