# Dynamo graph ProfileViewMigrationTests.dyn (Dynamo 2.19.4.6671)
# packages: Camber 4.2.6

current = Autodesk.AutoCAD.DynamoNodes.Document.Current()
getAllProfileViews = Camber.Civil.CivilObjects.ProfileView.GetAllProfileViews(document=current)
objects_types = AcObjectTypes("Alignment")
modelSpace = Autodesk.AutoCAD.DynamoNodes.Document.ModelSpace(document=current)
all_objects_of_type = AcObjectsOfType(type=objects_types, block=modelSpace)
origin = Point.Origin()
byPoint = Camber.Civil.CivilObjects.ProfileView.ByPoint(alignment=all_objects_of_type, location=origin)
number = DoubleInput(0)
getPointAtStationElevation = Camber.Civil.CivilObjects.ProfileView.GetPointAtStationElevation(profileView=byPoint, station=number, elevation=number)
getStationElevationAtPoint = Camber.Civil.CivilObjects.ProfileView.GetStationElevationAtPoint(profileView=byPoint, point=getPointAtStationElevation)
boolean = BoolSelector(true)
setElevationRangeMode = Camber.Civil.CivilObjects.ProfileView.SetElevationRangeMode(profileView=byPoint, modeToggle=boolean)
code_block = CodeBlock { 50; }
setElevations = Camber.Civil.CivilObjects.ProfileView.SetElevations(profileView=byPoint, minElevation=number, maxElevation=code_block)
setLocation = Camber.Civil.CivilObjects.ProfileView.SetLocation(profileView=byPoint, point=origin)
setStationRangeMode = Camber.Civil.CivilObjects.ProfileView.SetStationRangeMode(profileView=byPoint, modeToggle=code_block)
setStations = Camber.Civil.CivilObjects.ProfileView.SetStations(profileView=byPoint, startStation=number, endStation=code_block)
alignment = Camber.Civil.CivilObjects.ProfileView.Alignment(profileView=byPoint)
elevationRangeMode = Camber.Civil.CivilObjects.ProfileView.ElevationRangeMode(profileView=byPoint)
endStation = Camber.Civil.CivilObjects.ProfileView.EndStation(profileView=byPoint)
location = Camber.Civil.CivilObjects.ProfileView.Location(profileView=byPoint)
maxElevation = Camber.Civil.CivilObjects.ProfileView.MaxElevation(profileView=byPoint)
minElevation = Camber.Civil.CivilObjects.ProfileView.MinElevation(profileView=byPoint)
startStation = Camber.Civil.CivilObjects.ProfileView.StartStation(profileView=byPoint)
stationRangeMode = Camber.Civil.CivilObjects.ProfileView.StationRangeMode(profileView=byPoint)
