# Dynamo graph SampleLineGroupMigrationTests.dyn (Dynamo 2.19.4.6671)
# packages: Camber 4.2.6

objects_types = AcObjectTypes("Alignment")
current = Autodesk.AutoCAD.DynamoNodes.Document.Current()
modelSpace = Autodesk.AutoCAD.DynamoNodes.Document.ModelSpace(document=current)
all_objects_of_type = AcObjectsOfType(type=objects_types, block=modelSpace)
string = StringInput("Test")
byAlignment = Camber.Civil.CivilObjects.SampleLineGroup.ByAlignment(alignment=all_objects_of_type, groupName=string)
alignment = Camber.Civil.CivilObjects.SampleLineGroup.Alignment(sampleLineGroup=byAlignment)
sampleLines = Camber.Civil.CivilObjects.SampleLineGroup.SampleLines(sampleLineGroup=byAlignment)
