# Dynamo graph SampleLineMigrationTests.dyn (Dynamo 2.19.4.6671)
# packages: Camber 4.2.6

string = StringInput("Test")
objects_types = AcObjectTypes("Alignment")
current = Autodesk.AutoCAD.DynamoNodes.Document.Current()
modelSpace = Autodesk.AutoCAD.DynamoNodes.Document.ModelSpace(document=current)
all_objects_of_type = AcObjectsOfType(type=objects_types, block=modelSpace)
byAlignment = Camber.Civil.CivilObjects.SampleLineGroup.ByAlignment(alignment=all_objects_of_type, groupName=string)
number = DoubleInput(0)
byStation = Camber.Civil.CivilObjects.SampleLine.ByStation(name=string, sampleLineGroup=byAlignment, station=number)
lockToStation = Camber.Civil.CivilObjects.SampleLine.LockToStation(sampleLine=byStation)
setLockToStation = Camber.Civil.CivilObjects.SampleLine.SetLockToStation(sampleLine=byStation, bool=lockToStation)
station = Camber.Civil.CivilObjects.SampleLine.Station(sampleLine=byStation)
setStation = Camber.Civil.CivilObjects.SampleLine.SetStation(sampleLine=byStation, station=station)
geometry = Camber.Civil.CivilObjects.SampleLine.Geometry(sampleLine=byStation)
number_2 = Camber.Civil.CivilObjects.SampleLine.Number(sampleLine=byStation)
sampleLineGroup = Camber.Civil.CivilObjects.SampleLine.SampleLineGroup(sampleLine=byStation)
sectionViews = Camber.Civil.CivilObjects.SampleLine.SectionViews(sampleLine=byStation)
