# Dynamo graph SurfaceMigrationTests.dyn (Dynamo 2.19.4.6671)
# packages: Camber 4.2.6

objects_types = AcObjectTypes("Surface")
current = Autodesk.AutoCAD.DynamoNodes.Document.Current()
modelSpace = Autodesk.AutoCAD.DynamoNodes.Document.ModelSpace(document=current)
all_objects_of_type = AcObjectsOfType(type=objects_types, block=modelSpace)
origin = Point.Origin()
boolean = BoolSelector(false)
createWaterDrop = Camber.Civil.CivilObjects.Surfaces.Surface.CreateWaterDrop(surface=all_objects_of_type, startPoint=origin, create3DCurves=boolean)
setAutoRebuild = Camber.Civil.CivilObjects.Surfaces.Surface.SetAutoRebuild(surface=all_objects_of_type, bool=boolean)
setIsLocked = Camber.Civil.CivilObjects.Surfaces.Surface.SetIsLocked(surface=all_objects_of_type, bool=boolean)
autoRebuild = Camber.Civil.CivilObjects.Surfaces.Surface.AutoRebuild(surface=all_objects_of_type)
hasSnapshot = Camber.Civil.CivilObjects.Surfaces.Surface.HasSnapshot(surface=all_objects_of_type)
isLocked = Camber.Civil.CivilObjects.Surfaces.Surface.IsLocked(surface=all_objects_of_type)
isOutOfDate = Camber.Civil.CivilObjects.Surfaces.Surface.IsOutOfDate(surface=all_objects_of_type)
