# Dynamo graph TextMigrationTests.dyn (Dynamo 2.19.4.6671)
# packages: Camber 4.2.6

string = StringInput("Test")
origin = Point.Origin()
current = Autodesk.AutoCAD.DynamoNodes.Document.Current()
currentLayer = Autodesk.AutoCAD.DynamoNodes.Document.CurrentLayer(document=current)
modelSpace = Autodesk.AutoCAD.DynamoNodes.Document.ModelSpace(document=current)
create = Autodesk.AutoCAD.DynamoNodes.Text.Create(text=string, insertionPoint=origin, layer=currentLayer, block=modelSpace)
contents = Camber.AutoCAD.Objects.Text.Contents(text=create)
watch = Watch(contents)
height = Camber.AutoCAD.Objects.Text.Height(text=create)
watch_2 = Watch(height)
horizontalMode = Camber.AutoCAD.Objects.Text.HorizontalMode(text=create)
watch_3 = Watch(horizontalMode)
isBackward = Camber.AutoCAD.Objects.Text.IsBackward(text=create)
watch_4 = Watch(isBackward)
isUpsideDown = Camber.AutoCAD.Objects.Text.IsUpsideDown(text=create)
watch_5 = Watch(isUpsideDown)
obliquing = Camber.AutoCAD.Objects.Text.Obliquing(text=create)
watch_6 = Watch(obliquing)
position = Camber.AutoCAD.Objects.Text.Position(text=create)
watch_7 = Watch(position)
rotation = Camber.AutoCAD.Objects.Text.Rotation(text=create)
watch_8 = Watch(rotation)
setContents = Camber.AutoCAD.Objects.Text.SetContents(text=create, contents=contents)
watch_9 = Watch(setContents)
setHeight = Camber.AutoCAD.Objects.Text.SetHeight(text=create, height=height)
watch_10 = Watch(setHeight)
setIsBackward = Camber.AutoCAD.Objects.Text.SetIsBackward(text=create, bool=isBackward)
watch_11 = Watch(setIsBackward)
setIsUpsideDown = Camber.AutoCAD.Objects.Text.SetIsUpsideDown(text=create, bool=isUpsideDown)
watch_12 = Watch(setIsUpsideDown)
setObliquing = Camber.AutoCAD.Objects.Text.SetObliquing(text=create, angle=obliquing)
watch_13 = Watch(setObliquing)
setPosition = Camber.AutoCAD.Objects.Text.SetPosition(text=create, point=position)
watch_14 = Watch(setPosition)
setRotation = Camber.AutoCAD.Objects.Text.SetRotation(text=create, angle=rotation)
watch_15 = Watch(setRotation)
textStyle = Camber.AutoCAD.Objects.Text.TextStyle(text=create)
watch_16 = Watch(textStyle)
setTextStyle = Camber.AutoCAD.Objects.Text.SetTextStyle(text=create, textStyleName=textStyle)
watch_17 = Watch(setTextStyle)
verticalMode = Camber.AutoCAD.Objects.Text.VerticalMode(text=create)
watch_18 = Watch(verticalMode)
widthFactor = Camber.AutoCAD.Objects.Text.WidthFactor(text=create)
watch_19 = Watch(widthFactor)
setWidthFactor = Camber.AutoCAD.Objects.Text.SetWidthFactor(text=create, widthFactor=widthFactor)
watch_20 = Watch(setWidthFactor)
