# Dynamo graph TinSurfaceMigrationTests.dyn (Dynamo 2.19.4.6671)
# packages: Camber 4.2.6

current = Autodesk.AutoCAD.DynamoNodes.Document.Current()
string = StringInput("TestTIN")
surface_styles = SurfaceStyleDropDown("Border Only")
byName = Camber.Civil.CivilObjects.Surfaces.TinSurface.ByName(document=current, name=string, surfaceStyle=surface_styles)
