# Dynamo graph PipeNetwork_AddStructure.dyn (Dynamo 2.15.1.6076)
# packages: Camber 4.1.4

current = Autodesk.AutoCAD.DynamoNodes.Document.Current()
getPipeNetworks = Camber.Civil.PipeNetworks.PipeNetwork.GetPipeNetworks(document=current)
code_block = CodeBlock(a=getPipeNetworks) { a[0]; }
origin = Point.Origin()
getPartsLists = Camber.Civil.PipeNetworks.PartsList.GetPartsLists(document=current)
code_block_2 = CodeBlock(a=getPartsLists) { a[1]; }
structureFamilies = Camber.Civil.PipeNetworks.PartsList.StructureFamilies(partsList=code_block_2)
code_block_3 = CodeBlock(a=structureFamilies) { a[1]; }
partSizes = Camber.Civil.PipeNetworks.PartFamily.PartSizes(partFamily=code_block_3)
byPoint = Camber.Civil.PipeNetworks.Parts.Structure.ByPoint(pipeNetwork=code_block, point=origin, partFamily=code_block_3, partSize=partSizes)
