# Dynamo graph PipeNetwork_ConnectStructureToPipe.dyn (Dynamo 2.15.1.6076)
# packages: Camber 4.1.4

select_object = ObjectSelection()  # 1 picked in the model
convert_to_camber_object = ConvertToCamberObject(object=select_object)
select_object_2 = ObjectSelection()  # 1 picked in the model
convert_to_camber_object_2 = ConvertToCamberObject(object=select_object_2)
boolean = BoolSelector(false)
connectToPipe = Camber.Civil.PipeNetworks.Parts.Structure.ConnectToPipe(structure=convert_to_camber_object, pipe=convert_to_camber_object_2, connectToStart=boolean)
