# Dynamo graph PolylineTests.dyn (Dynamo 2.13.1.3887)
# packages: Camber 4.0.0

boolean = BoolSelector(true)
pruneDuplicateVertices = Camber.AutoCAD.Objects.Polyline.PruneDuplicateVertices(keepFirst=boolean)  # unwired: polyline
objects_types = AcObjectTypes("Polyline")
current = Autodesk.AutoCAD.DynamoNodes.Document.Current()
modelSpace = Autodesk.AutoCAD.DynamoNodes.Document.ModelSpace(document=current)
all_objects_of_type = AcObjectsOfType(type=objects_types, block=modelSpace)
vertices = Camber.AutoCAD.Objects.Polyline.Vertices(polyline=all_objects_of_type)
watch = Watch(vertices)
duplicateVerticesCount = Camber.AutoCAD.Objects.Polyline.DuplicateVerticesCount(polyline=all_objects_of_type)
watch_2 = Watch(duplicateVerticesCount)
objects_types_2 = AcObjectTypes("Polyline3D")
all_objects_of_type_2 = AcObjectsOfType(type=objects_types_2, block=modelSpace)
duplicateVerticesCount_2 = Camber.AutoCAD.Objects.Polyline3D.DuplicateVerticesCount(polyline3d=all_objects_of_type_2)
vertices_2 = Camber.AutoCAD.Objects.Polyline3D.Vertices(polyline3d=all_objects_of_type_2)
pruneDuplicateVertices_2 = Camber.AutoCAD.Objects.Polyline3D.PruneDuplicateVertices()  # unwired: polyline3d
code_block = CodeBlock { false; }
