# Dynamo graph BoundaryTests.dyn (Dynamo 2.15.1.6076)
# packages: Camber 4.2.2, Civil3DToolkit 1.1.32

select_object = ObjectSelection()  # 1 picked in the model
select_objects = ObjectsSelection()  # 4 picked in the model
surface_boundary_types = SurfaceBoundaryTypesDropDown("Hide", EnumerationType="Autodesk.Civil.SurfaceBoundaryType, AeccDbMgd, Version=13.5.1125.0, Culture=neutral, PublicKeyToken=null", AddSpaces=true, DropLastCharacter=false)
addBoundary = Camber.Civil.CivilObjects.Surfaces.Surface.AddBoundary(surface=select_object, boundaryObject=select_objects, boundaryType=surface_boundary_types)
select_object_2 = ObjectSelection()  # 1 picked in the model
vertices = Camber.AutoCAD.Objects.Polyline.Vertices(polyline=select_object_2)
byPoints = Polygon.ByPoints(points=vertices)
addBoundary_2 = Camber.Civil.CivilObjects.Surfaces.Surface.AddBoundary(surface=select_object, boundaryPolygon=byPoints, boundaryType=surface_boundary_types)
