# Dynamo graph TINSurface_CreateFromDEMTest.dyn (Dynamo 2.13.1.3887)
# packages: Camber 4.0.0

current = Autodesk.AutoCAD.DynamoNodes.Document.Current()
code_block = CodeBlock { "test1"; }
surface_styles = SurfaceStyleDropDown("Border Only")
byName = Camber.Civil.CivilObjects.Surfaces.TinSurface.ByName(document=current, name=code_block, surfaceStyle=surface_styles)
file_path = Filename("..\GridSurface\491_926.asc")
addDEMFile = Camber.Civil.CivilObjects.Surfaces.TinSurface.AddDEMFile(tinSurface=byName, filePath=file_path)
