# Dynamo graph TINVolumeSurfaceTests.dyn (Dynamo 2.13.1.3887)
# packages: Camber 4.0.0

current = Autodesk.AutoCAD.DynamoNodes.Document.Current()
string = StringInput("Volume")
string_2 = StringInput("EG")
current_2 = Autodesk.AutoCAD.DynamoNodes.Document.Current()
surfaceByName = Autodesk.Civil.DynamoNodes.Selection.SurfaceByName(name=string_2, document=current_2)
string_3 = StringInput("Corridor Surface")
current_3 = Autodesk.AutoCAD.DynamoNodes.Document.Current()
surfaceByName_2 = Autodesk.Civil.DynamoNodes.Selection.SurfaceByName(name=string_3, document=current_3)
surface_styles = SurfaceStyleDropDown("Cut and Fill Banding 1’ Interval (2D)")
byTwoSurfaces = Camber.Civil.CivilObjects.Surfaces.TinVolumeSurface.ByTwoSurfaces(document=current, surfaceName=string, baseSurface=surfaceByName, comparisonSurface=surfaceByName_2, style=surface_styles)
