# Dynamo graph XrefTests.dyn (Dynamo 2.15.1.6076)
# packages: Camber 4.1.4

current = Autodesk.AutoCAD.DynamoNodes.Document.Current()
current_2 = Autodesk.AutoCAD.DynamoNodes.Document.Current()
modelSpace = Autodesk.AutoCAD.DynamoNodes.Document.ModelSpace(document=current_2)
file_path = Filename("C:\Software Projects\Camber\tests\Xref\Xref01.dwg")
boolean = BoolSelector(true)
code_block = CodeBlock { "Test"; }
insertFromFile = Camber.AutoCAD.Xref.InsertFromFile(document=current, block=modelSpace, filePath=file_path, overlay=boolean, layer=code_block)
